# Grasshopper definition filippo_trinaglestent.gh (Grasshopper 1.0.8)

crv = Curve(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)
geometry = GetGeometry(crv, AnnotationTypeFilter=3966, AtLeast=1, AtMost=1, DeleteInput=False, Filter=1074081855, TreeAccess=False)
resolution = GetInteger(Slider(6, range=0..100), AtLeast=1, AtMost=1, Maximum=2147483647, Minimum=-2147483648, TreeAccess=False)
x_scaling = GetInteger(Slider(3, range=0..100), AtLeast=1, AtMost=1, Maximum=2147483647, Minimum=-2147483648, TreeAccess=False)
y_scaling = GetInteger(Slider(7, range=1..101), AtLeast=1, AtMost=1, Maximum=2147483647, Minimum=-2147483648, TreeAccess=False)
X = UnitX(Factor=x_scaling)
yz = YZPlane(Origin=Point(0, 0, 0))
move = Move(Geometry=yz, Motion=X)  # -> Geometry, Transform
mirror = Mirror(Geometry=geometry, Plane=move.Geometry)  # -> Geometry, Transform
divide = DivideCurve(Curve=geometry, Count=y_scaling, Kinks=False)  # -> Points, Tangents, Parameters
divide_2 = DivideCurve(Curve=mirror.Geometry, Count=y_scaling, Kinks=False)  # -> Points, Tangents, Parameters
Z = UnitZ(Factor=1)
neg = Negative(Value=Z)
biarc = BiArc(StartPoint=divide.Points, StartTangent=Z, EndPoint=divide_2.Points, EndTangent=neg, Ratio=0.5)  # -> FirstArc, SecondArc, BiArc
divide_3 = DivideCurve(Curve=biarc.BiArc, Count=resolution, Kinks=False)  # -> Points, Tangents, Parameters
viewer = ParamViewer(divide_3.Points)
viewer_2 = ParamViewer(divide_3.Points)
cull = CullPattern(List=viewer, CullPattern=[True, False])
cull_2 = CullPattern(List=viewer_2, CullPattern=[False, True])
branch = TreeBranch(Tree=divide_3.Points, Path=cull, MaintainPaths=True)
branch_2 = TreeBranch(Tree=divide_3.Points, Path=cull_2, MaintainPaths=True)
cull_3 = CullPattern(List=branch, CullPattern=[True, False])
cull_4 = CullPattern(List=branch_2, CullPattern=[False, True])
cull_i = CullIndex(List=cull_3, Indices="0", Wrap=True)
ln = Line(StartPoint=cull_3, EndPoint=cull_4)
viewer_3 = ParamViewer(cull_3)
cull_i_2 = CullIndex(List=viewer_3, Indices="0", Wrap=True)
branch_3 = TreeBranch(Tree=cull_3, Path=cull_i_2, MaintainPaths=True)
ln_2 = Line(StartPoint=branch_3, EndPoint=cull_4)
cull_i_3 = CullIndex(List=branch_3, Indices="0", Wrap=True)
cull_i_4 = CullIndex(List=ln_2, Indices="-1", Wrap=True)
ln_3 = Line(StartPoint=cull_i_3, EndPoint=cull_4)
viewer_4 = ParamViewer(ln_3)
viewer_5 = ParamViewer(cull_i_4)
cull_i_5 = CullIndex(List=viewer_4, Indices="-1", Wrap=True)
cull_i_6 = CullIndex(List=viewer_5, Indices="-1", Wrap=True)
cull_i_7 = CullIndex(List=ln, Indices="-1", Wrap=True)
ln_4 = Line(StartPoint=cull_i, EndPoint=cull_4)
branch_4 = TreeBranch(Tree=cull_i_4, Path=cull_i_6, MaintainPaths=True)
branch_5 = TreeBranch(Tree=ln_3, Path=cull_i_5, MaintainPaths=True)
cull_i_8 = CullIndex(List=branch_4, Indices="0", Wrap=True)
cull_i_9 = CullIndex(List=cull_i_7, Indices="0", Wrap=True)
edgesrf = EdgeSurface(CurveA=branch_5, CurveB=branch_4)
edgesrf_2 = EdgeSurface(CurveA=branch_5, CurveB=cull_i_8)
edgesrf_3 = EdgeSurface(CurveA=ln_4, CurveB=cull_i_7)
edgesrf_4 = EdgeSurface(CurveA=ln_4, CurveB=cull_i_9)
cull_i_10 = CullIndex(List=edgesrf, Indices="-1", Wrap=True)
cull_i_11 = CullIndex(List=edgesrf_3, Indices="-1", Wrap=True)
merge = Merge(Data1=cull_i_10, Data2=cull_i_11, Data3=edgesrf_2, Data4=edgesrf_4)  # -> flatten(Result)
geo = Geometry(merge)
context_bake = ContextBake(GEOMETRY=geo)
