# Grasshopper definition hops_test.gh (Grasshopper 1.0.8)
# plug-ins: Hops

hops = Hops(
    GEOMETRY=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,
    X_SCALING=Slider(3, range=0..100),
    Y_SCALING=Slider(7, range=1..101),
    RESOLUTION=Slider(6, range=0..100),
    CacheResultsInMemory=True,
    CacheSolveResults=True,
    RemoteDefinitionLocation="C:\Users\joaqu\Downloads\filippo_trinaglestent.gh",
    RemoteSolveVersion=(0, 1, 0),
    ShowInput_Enabled=False,
    ShowInput_Path=False,
    SynchronousSolve=True)
